# Grasshopper definition socket.gh (Grasshopper 0.9.76)
# plug-ins: MyNode

nickname = MyNode(BotUrl="ws://localhost:9012", url="ws://localhost:9012")
rec = DataRecorder(nickname, DataLimit=-10, RecordData=True)
pt = Point(nickname)
panel = Panel(rec)
